# Grasshopper definition SDMMinSurf.ghx (Grasshopper 0.9.76)
# plug-ins: MeshEdit Components, Python Interpreter, TT Toolbox

# ---- group: Analytically generated PH for comparison
côté_carré = Slider(100, range=0..100)
hauteur = Slider(50, range=0..100)
N = Steps(100)
division = Division(A=côté_carré, B=2)
neg = Negative(Value=division)
multiplication = Multiplication(A=division, B=côté_carré)
# Mathematical Solution
dom = ConstructDomain(DomainStart=neg, DomainEnd=division)
range = Range(Domain=dom, Steps=N)
division_2 = Division(A=multiplication, B=hauteur)
multiplication_2 = Multiplication(A=graft(range), B=reverse(range))
division_3 = Division(A=multiplication_2, B=division_2)
pt = ConstructPoint(XCoordinate=graft(range), YCoordinate=reverse(range), ZCoordinate=division_3)  # -> flatten(Point)
addition = Addition(A=N, B=1)
srfgrid = SurfaceFromPoints(Points=pt, UCount=addition, Interpolate=False)

# ---- group: Options
# Options
mesh = Mesh(<mesh referenced from the Rhino model>)
number_slider = Slider(1, range=0..100)
pressure = Slider(0, range=-10..100)
density = Slider(0, range=-10..100)
pt_2 = Point(<point referenced from the Rhino model>)
cables = Curve([<curve referenced from the Rhino model> x5])
q_cables = Slider(1000, range=0..10000)
toggle = BooleanToggle(True)
toggle_2 = BooleanToggle(True)
max_disp = Slider(0.001, range=0..0.1)
max_iter = Slider(50, range=0..1000)
number_slider_2 = Slider(4, range=0..10)
number_slider_3 = Slider(0, range=0..0.01)
number_slider_4 = Slider(1, range=0..1)
panel = Panel("seidel")
panel_2 = Panel("fixed-point")
panel_3 = Panel("gradient")

# ---- group: Build Problem
mesh_cp = PythonScript(points=pt_2, mesh=mesh)  # -> fixed; inputs points: list
# ---------- mesh_cp: Python ----------
"""
Find the vertices closest to each point in a collection, on a mesh
"""

from meshminimizehelpers import mesh_closest_vertices

fixed = mesh_closest_vertices(mesh, points)
# ---------- end mesh_cp ----------
kroto_edges = PythonScript(mesh=mesh)  # -> KEdges; inputs mesh: Mesh, fixed: list of Boolean, cables: list of Curve, q_cables: list
# ---------- kroto_edges: Python ----------
"""
Wrapper block for defining the edges of the problem: cables and fixed-points
"""

import rhinoscriptsyntax as rs
import meshminimizehelpers as mmh


class KEdges:
    """
    Emulates a custom type for the edges of the problem
    """
    
    def __init__(self, cables, q_cables, vertices, naked, fixed):
        """
        Initiate cables and edges with dedicated method from meshminimize
        """
        self.cables = cables
        self.q_cables = q_cables
        (self.ql, self.n_cable, self.fixed) = mmh.define_cables(
            cables, q_cables, vertices, naked, fixed
        )
        
    def __str__(self):
        """Simple display for error checking"""
        str = ''
        for key in self.__dict__:
            str += "%s: %s\n" % (key, self.__dict__[key])
        return str
        
"""Create default fixed points parameter"""
if not fixed:
    if not cables:
        #Edges are fixed when no cables are defined
        fixed = rs.MeshNakedEdgePoints(mesh)
    else:
        # Fixed points will be defined by mm.define_cables, initialize to
        # none fixed
        fixed = [False for i in rs.MeshVertices(mesh)]
        
"""Create default cables density parameter"""
if not q_cables:
    #Default: 1
    q_cables = [1 for i in cables]
elif len(q_cables) == 1:
    #Allows to pass in one number for all cables
    q_cables = [q_cables[0] for i in cables]
        
        
KEdges = KEdges(
    cables,
    q_cables,
    rs.MeshVertices(mesh),
    rs.MeshNakedEdgePoints(mesh),
    fixed
)
# ---------- end kroto_edges ----------
kroto_options = PythonScript(
    save_results=toggle_2,
    max_disp=max_disp,
    max_iter=max_iter,
    max_iter_qs=number_slider_2,
    max_dev_sigma=number_slider_3,
    speed=number_slider_4,
    method=panel)  # -> KOptions; inputs max_iter: Int32
# ---------- kroto_options: Python ----------
"""
Block externalizing options for the solver
"""

class KOptions:
    """
    Emulates a custom type to pass the options to the solver
    """
    
    def __init__(self, save_results, max_disp, max_iter, max_iter_qs,
                 max_dev_sigma, speed, method):
        self.save_results = save_results
        self.max_disp = max_disp
        self.max_iter = max_iter
        self.max_iter_qs = max_iter_qs
        self.max_dev_sigma = max_dev_sigma
        self.speed = speed
        self.method = method
        
    def __str__(self):
        """Simple display for error checking"""
        str = ''
        for key in self.__dict__:
            str += "%s: %s\n" % (key, self.__dict__[key])
        return str
            
KOptions = KOptions(save_results, max_disp, max_iter, max_iter_qs, max_dev_sigma, speed,
                    method)
# ---------- end kroto_options ----------
# Solver
kroto_problem = PythonScript(mesh=mesh, q_faces=number_slider, pressure=pressure, density=density, KEdges=kroto_edges)  # -> KMesh; inputs mesh: Mesh, q_faces: list, reference: Mesh
# ---------- kroto_problem: Python ----------
"""
Block for outsourcing the mesh problem definitions
"""

import rhinoscriptsyntax as rs
import copy

class KMesh:
    """
    Emulates a custom type to pass the mesh problem to the solver
    """
    
    def __init__(self, mesh, KEdges, q_faces, pressure, density, reference):
        self.cables = KEdges.cables
        self.fixed = KEdges.fixed
        self.q_faces = q_faces
        self.ql = KEdges.ql
        self.q_cables = KEdges.q_cables
        self.n_cable = KEdges.n_cable
        self.pressure = pressure
        self.density = density
        self.mesh = mesh
        self.reference = reference
        
    def __str__(self):
        """Simple display for error checking"""
        str = ''
        for key in self.__dict__:
            str += "%s: %s\n" % (key, self.__dict__[key])
        return str
        
        
#Create defaults (1) for the surface density
if not q_faces:
    q_faces = [1 for i in range(rs.MeshFaceCount(mesh))]
elif len(q_faces) == 1:
    q_faces = [q_faces[0] for i in range(rs.MeshFaceCount(mesh))]
#Create defaults (current mesh) for the reference mesh
if not reference: reference = rs.MeshVertices(mesh)

KMesh = KMesh(mesh, KEdges, q_faces, pressure, density, reference)
# ---------- end kroto_problem ----------
panel_4 = Panel("init")
panel_5 = Panel("step")
kroto_solver = PythonScript(state="run", run=Button(), KMesh=kroto_problem, KEdges=kroto_edges, KOptions=kroto_options)  # -> mesh_out, displacements, F_membrane, F_cable, F_pressure, F_gravity, area, stresses, convergence; inputs run: Boolean, KEdges: list
# ---------- kroto_solver: Python ----------
#!/usr/bin/env python
# -*- coding: utf-8 -*-

"""
Wrapper block encapsulating the meshminimize module
"""

import meshminimize as mm
import rhinoscriptsyntax as rs
import ghpythonlib.components as ghcomp
import copy
import scriptcontext


# Useful values
zero_vector = rs.VectorCreate(rs.AddPoint(0, 0, 0), rs.AddPoint(0, 0, 0))
def solve():
    return mm.minimize_mesh(
        cur_mesh,
        KMesh.cables, 
        fixed=KMesh.fixed, 
        qs=cur_qs,
        q_cables=KMesh.q_cables, 
        reference=KMesh.reference, 
        ql=KMesh.ql, 
        n_cable=KMesh.n_cable,
        P=KMesh.pressure,
        G=KMesh.density
        )
# Remember GHPython where we are, sometimes it forgets
if state in ['step', 'run']:
    cur_mesh = rs.AddMesh(vertices, rs.MeshFaceVertices(KMesh.mesh))


if state == 'init':
    # Initialize current state information
    step = 0
    step_qs = 0
    ran = False

    # Pass KOptions to the MeshMinimize module
    for key in KOptions.__dict__:
        mm.__dict__[str.upper(key)] = KOptions.__dict__[key]

    # Initialize inputs
    vertices = rs.MeshVertices(KMesh.mesh)
    cur_mesh = KMesh.mesh
    cur_qs = copy.deepcopy(KMesh.q_faces)

    # Initialize outputs
    mesh_out = rs.AddMesh(vertices, rs.MeshFaceVertices(KMesh.mesh))
    displacements = [zero_vector for i in range(len(vertices))]
    out = None

elif state == 'step':
    # Running step-by-step. We need to take care of the loops controls
    # ourselves: use the meshminimize options to stop it. KOptions will
    # keep the original values.
    if run:
        if KOptions.max_iter - step:
            mm.MAX_ITER = 1
            mm.MAX_ITER_QS = 1
            step += 1
            vertices, out = solve()
        elif KOptions.max_iter_qs - step_qs:
            mm.MAX_ITER = 0
            mm.MAX_ITER_QS = 2
            step_qs += 1
            step = 0
            vertices, out = solve()
        else:
            mm.MAX_ITER = 0
            mm.MAX_ITER_QS = 1
            vertices, out = solve()
        ran = True

elif state == 'run':
    if run:
        vertices, out = solve()
        ran = True

# Write ouptuts
if (state in ['step', 'run']) and ran and not run:
    mesh_out = rs.AddMesh(vertices, rs.MeshFaceVertices(KMesh.mesh))
    displacements = [
        rs.VectorCreate(v1, v2)
        for (v1, v2) in zip(rs.MeshVertices(KMesh.mesh), vertices)
    ]
    stresses = out['S']
    convergence = out['convergence']
    if mm.SAVE_RESULTS:
        F_membrane = out['M']
        F_cable = out['C']
        F_pressure = out['P']
        F_gravity = out['G']
        area = out['A']
# ---------- end kroto_solver ----------

# ---- group: Raw Inputs
check_options = Panel(kroto_options)
# Inputs
check_problem = Panel(kroto_problem)

# ----
toggle_3 = BooleanToggle(True)
log_log = LogLog(x=kroto_solver.area)
graph = QuickGraph(log_log)

# ---- group: Compare with mathematical solution
mesh_2 = Mesh(kroto_solver.mesh_out)
demesh = DeconstructMesh(Mesh=mesh_2)  # -> Vertices, Faces, Colours, Normals
srf_cp = SurfaceClosestPoint(Point=demesh.Vertices, Surface=srfgrid)  # -> Point, UVPoint, Distance
sqr = Square(Value=srf_cp.Distance)
bnd = Bounds(Numbers=sqr)
# Display
dedomain = DeconstructDomain(Domain=bnd)  # -> Start, End
max_error = Panel(dedomain.End)

# ----
number_slider_5 = Slider(0, range=0..100)
repeat = RepeatData(Data=graft([Slider(0, range=0..100), number_slider_5]), Length=max_iter)
series = Series(Start=1, Step=1, Count=max_iter)  # -> simplify(graft(Series))
flip = FlipMatrix(Data=repeat)  # -> simplify(Data)
path = ConstructPath(Indices=[flip, series])
path_mapper = PathMapper(kroto_solver.F_cable, source="{A;B;C}", target="{A;C;B}")
branch = TreeBranch(Tree=path_mapper, Path=path, MaintainPaths=True)
panel_6 = Panel(branch)

# ---- group: Raw Outputs
convergence_criterion = Panel(kroto_solver.convergence)
graph_2 = QuickGraph(convergence_criterion)
lng = ListLength(List=convergence_criterion)
# Outputs
iterations_count = Panel(lng)
stresses = Panel(kroto_solver.stresses)

# ---- group: Displacements
demesh_2 = DeconstructMesh(Mesh=mesh)  # -> Vertices, Faces, Colours, Normals
vec = Vector(kroto_solver.displacements)
dprod = DotProduct(VectorA=demesh_2.Normals, VectorB=vec, Unitize=False)
vlen = VectorLength(Vector=vec)
bnd_2 = Bounds(Numbers=dprod)
bnd_3 = Bounds(Numbers=vlen)
displacement_along_normal_final_mesh = Panel(bnd_2)
displacement_length = Panel(bnd_3)

# ---- group: Raw Outputs (continued)
displacements = Panel(vlen)

# ----
item = ListItem(List=vec, Index=number_slider_5, Wrap=True)
item_2 = ListItem(List=demesh_2.Vertices, Index=number_slider_5, Wrap=True)

# ---- group: Displacements (continued)
vdis = VectorDisplay(Anchor=item_2, Vector=expr("-x", item))

# ---- group: Colorize output based on stresses
bnd_4 = Bounds(Numbers=kroto_solver.stresses)
medges = MeshEdges(Mesh=kroto_solver.mesh_out)  # -> NakedEdges, InteriorEdges, NonManifoldEdges
dedomain_2 = DeconstructDomain(Domain=bnd_4)  # -> Start, End
expression = Expression(x=dedomain_2.Start, y=dedomain_2.End, Expression="If(abs(x-y)<1, y+1, y)")
expression_2 = Expression(x=dedomain_2.Start, y=expression, Expression="(y-x)/4*.99")
series_2 = Series(Start=dedomain_2.Start, Step=expression_2, Count=5)
gradient = Gradient(
    LowerLimit=dedomain_2.Start,
    UpperLimit=expression,
    Parameter=kroto_solver.stresses,
    stops=[0.249: RGB(255, 0, 0), 0.503: RGB(255, 255, 0), 0.755: RGB(0, 255, 0)])
explode = MeshExplode(Mesh=kroto_solver.mesh_out, Interpolate=False)
mcol = MeshColours(Mesh=graft(explode), Colours=graft(gradient))

# ----
split = SplitList(List=series_2, Index=1)  # -> ListA, ListB

# ---- group: Colorize output based on stresses (continued)
gradient_2 = Gradient(
    LowerLimit=dedomain_2.Start,
    UpperLimit=expression,
    Parameter=split.ListB,
    stops=[0.249: RGB(255, 0, 0), 0.503: RGB(255, 255, 0), 0.755: RGB(0, 255, 0)])
stepped_colour_legend = SteppedColourLegend(Colours=gradient_2, Start=dedomain_2.Start, End=expression, Title="Stresses", Description=" ")

# ==== cluster LogLog
lng = ListLength()
series = Series(Start=1, Step=1, Count=lng)
log = Logarithm(Value=series)
expression = Expression(x=lng, y=log, Expression="y/(Log10(x)-Log10(x-1))")
int = Integer(expression)
x = ClusterInput()
series_2 = Series(Start=1, Step=1, Count=0)
bnd = Bounds(Numbers=int)
repeat = RepeatData(Data=series_2, Length=expr("x+1", bnd))
log_2 = Logarithm(Value=x)
ins = InsertItems(List=repeat, Item=log_2, Indices=int, Wrap=False)
L = ClusterOutput(ins)
