# Grasshopper definition KExamples_Scherk.ghx (Grasshopper 0.9.76)
# plug-ins: Python Interpreter

# ---- group: Analytically generated Scherk's 1st surface for comparison
side_length = Slider(200, range=0..1000)
subdivisions = Slider(100, range=0..100)
pi = Pi(Factor=0.5)
division = Division(A=3.141592654, B=side_length)
division_2 = Division(A=pi, B=division)
dom = ConstructDomain(DomainStart=expr("-x", division_2), DomainEnd=division_2)
range = Range(Domain=dom, Steps=subdivisions)
shift = ShiftList(List=range, Shift=1, Wrap=False)
# Mathematical Solution
shift_2 = ShiftList(List=shift, Shift=-1, Wrap=False)
expression = Expression(x=graft(shift_2), y=shift_2, a=division, Expression="Ln(Cos(a*x)/Cos(a*y))/a")
pt = ConstructPoint(XCoordinate=graft(shift_2), YCoordinate=shift_2, ZCoordinate=expression)  # -> flatten(Point)
srfgrid = SurfaceFromPoints(Points=pt, UCount=expr("x-1", subdivisions), Interpolate=False)

# ---- group: Options
# Options
mesh = Mesh(<mesh referenced from the Rhino model>)
number_slider = Slider(1, range=0..100)
pressure = Slider(0, range=-10..100)
density = Slider(0, range=-10..100)
toggle = BooleanToggle(False)
max_disp = Slider(0.08, range=0..0.1)
max_iter = Slider(100, range=0..1000)
number_slider_2 = Slider(4, range=0..10)
number_slider_3 = Slider(0, range=0..0.01)
number_slider_4 = Slider(1, range=0..1)
panel = Panel("seidel")
panel_2 = Panel("fixed-point")
panel_3 = Panel("gradient")
# Inputs
toggle_2 = BooleanToggle(True)

# ----
tri = Triangulate(Mesh=mesh)  # -> Mesh, Count

# ---- group: Build Problem
options = KrotoOptions(
    save_results=toggle,
    max_disp=max_disp,
    max_iter=max_iter,
    max_iter_qs=number_slider_2,
    max_dev_sigma=number_slider_3,
    speed=number_slider_4,
    method=panel,
    fixed_cable_ends=toggle_2)  # -> KOptions; inputs max_iter: Int32
# ---------- options: Python ----------
"""
Define the options for the Kroto solver.
"""

class KOptions:
    """
    Custom type to pass the options to the solver
    """

    def __init__(self, save_results, max_disp, max_iter, max_iter_qs,
                 max_dev_sigma, speed, method, fixed_cable_ends):
        self.save_results = save_results
        self.max_disp = max_disp
        self.max_iter = max_iter
        self.max_iter_qs = max_iter_qs
        self.max_dev_sigma = max_dev_sigma
        self.speed = speed
        self.method = method
        self.fixed_cable_ends = fixed_cable_ends

    def __str__(self):
        """Simple display for error checking"""
        str = ''
        for key in self.__dict__:
            str += "%s: %s\n" % (key, self.__dict__[key])
        return str


KOptions = KOptions(
    save_results,
    max_disp,
    max_iter,
    max_iter_qs,
    max_dev_sigma,
    speed,
    method,
    fixed_cable_ends
)
# ---------- end options ----------
edges = KrotoEdges(mesh=mesh)  # -> KEdges; inputs mesh: Mesh, fixed: list of Boolean, cables: list of Curve, q_cables: list
# ---------- edges: Python ----------
"""
Define the edges of a problem for Kroto: cables and fixed-points.
"""

import Grasshopper as gh
import sys
import os

ghcompfolder = gh.Folders.DefaultAssemblyFolder
krotofolder = os.path.join(ghcompfolder, 'Kroto')
if krotofolder not in sys.path:
    sys.path.append(krotofolder)

import rhinoscriptsyntax as rs
import meshminimizehelpers as mmh

prev = rs.EnableRedraw(False)

class KEdges:
    """
    Emulates a custom type for the edges of the problem
    """

    def __init__(self, cables, q_cables, vertices, naked, fixed):
        """
        Initiate cables and edges with dedicated method from meshminimize
        """
        self.cables = cables
        self.q_cables = q_cables
        (self.ql, self.n_cable, self.fixed) = mmh.define_cables(
            cables, q_cables, vertices, naked, fixed
        )

    def __str__(self):
        """Simple display for error checking"""
        str = ''
        for key in self.__dict__:
            str += "%s: %s\n" % (key, self.__dict__[key])
        return str

# Create default fixed points parameter
if not fixed:
    if not cables:
        # Edges are fixed when no cables are defined
        fixed = rs.MeshNakedEdgePoints(mesh)
    else:
        # Fixed points will be defined by mm.define_cables, initialize to
        # none fixed
        fixed = [False for i in rs.MeshVertices(mesh)]

# Create default cables density parameter
if not q_cables:
    # Default: 1
    q_cables = [1 for i in cables]
elif len(q_cables) == 1:
    # Allows to pass in one number for all cables
    q_cables = [q_cables[0] for i in cables]
        
        
KEdges = KEdges(
    cables,
    q_cables,
    rs.MeshVertices(mesh),
    rs.MeshNakedEdgePoints(mesh),
    fixed
)

rs.EnableRedraw(prev)
# ---------- end edges ----------
problem = KrotoProblem(mesh=tri.Mesh, q_faces=number_slider, pressure=pressure, density=density, KEdges=edges)  # -> KMesh; inputs mesh: Mesh, q_faces: list, reference: Mesh
# ---------- problem: Python ----------
"""
Define a problem for the Kroto solver.
"""

import Grasshopper as gh
import sys
import os

ghcompfolder = gh.Folders.DefaultAssemblyFolder
krotofolder = os.path.join(ghcompfolder, 'Kroto')
if krotofolder not in sys.path:
    sys.path.append(krotofolder)

import rhinoscriptsyntax as rs
import copy

prev = rs.EnableRedraw(False)

class KMesh:
    """
    Custom type to pass the mesh problem to the solver
    """

    def __init__(self, mesh, KEdges, q_faces, pressure, density, reference):
        if KEdges:
            self.cables = KEdges.cables
            self.fixed = KEdges.fixed
            self.q_faces = q_faces
            self.ql = KEdges.ql
            self.q_cables = KEdges.q_cables
            self.n_cable = KEdges.n_cable
        else:
            self.cables = None
            self.fixed = None
            self.q_faces = None
            self.ql = None
            self.q_cables = None
            self.n_cable = None
        self.pressure = pressure
        self.density = density
        self.mesh = mesh
        self.reference = reference

    def __str__(self):
        """Simple display for error checking"""
        str = ''
        for key in self.__dict__:
            str += "%s: %s\n" % (key, self.__dict__[key])
        return str


# Create defaults (= 1) for the surface density
if not q_faces:
    q_faces = [1 for i in range(rs.MeshFaceCount(mesh))]
elif len(q_faces) == 1:
    q_faces = [q_faces[0] for i in range(rs.MeshFaceCount(mesh))]
# Pressure and density defaults to 0
if not pressure: pressure = 0
if not density: density = 0
# Create defaults (= current mesh) for the reference mesh
if not reference: reference = rs.MeshVertices(mesh)

KMesh = KMesh(mesh, KEdges, q_faces, pressure, density, reference)

rs.EnableRedraw(prev)
# ---------- end problem ----------
solver = KrotoSolver(state="init", run=Toggle(True), KMesh=problem, KOptions=options)  # -> mesh_out, displacements, F_membrane, F_cable, F_pressure, F_gravity, area, stresses, convergence; inputs run: Boolean
# ---------- solver: Python ----------
#!/usr/bin/env python
# -*- coding: utf-8 -*-

"""
The Kroto solver.
"""

import Grasshopper as gh
import sys
import os

ghcompfolder = gh.Folders.DefaultAssemblyFolder
krotofolder = os.path.join(ghcompfolder, 'Kroto')
if krotofolder not in sys.path:
    sys.path.append(krotofolder)

import meshminimize as mm
import rhinoscriptsyntax as rs
import copy
from imp import reload
reload(mm)

prev = rs.EnableRedraw(False)

# Useful value
zero_vector = rs.VectorCreate(rs.AddPoint(0, 0, 0), rs.AddPoint(0, 0, 0))

if state in ['step', 'run']:
    # Remind GHPython where we are, sometimes it forgets
    cur_mesh = rs.AddMesh(vertices, rs.MeshFaceVertices(KMesh.mesh))
    # Update KOptions to the MeshMinimize module
    if KOptions:
        for key in KOptions.__dict__:
            if KOptions.__dict__[key]:
                mm.__dict__[str.upper(key)] = KOptions.__dict__[key]
    # Short-hand for the solve operation
    def solve():
        return mm.minimize_mesh(
            cur_mesh,
            KMesh.cables, 
            fixed=KMesh.fixed,
            qs=cur_qs,
            q_cables=KMesh.q_cables, 
            reference=KMesh.reference, 
            ql=KMesh.ql, 
            n_cable=KMesh.n_cable,
            p=KMesh.pressure,
            g=KMesh.density
        )
print KMesh.density
if state == 'init':
    # Initialize current state information
    step = 0
    step_qs = 0
    ran = False

    # Pass KOptions to the MeshMinimize module
    if KOptions:
        for key in KOptions.__dict__:
            if KOptions.__dict__[key]:
                mm.__dict__[str.upper(key)] = KOptions.__dict__[key]

    # Initialize inputs
    vertices = rs.MeshVertices(KMesh.mesh)
    cur_mesh = KMesh.mesh
    cur_qs = copy.deepcopy(KMesh.q_faces)

    # Initialize outputs
    mesh_out = rs.AddMesh(vertices, rs.MeshFaceVertices(KMesh.mesh))
    displacements = [zero_vector for i in range(len(vertices))]
    out = None

elif state == 'step':
    # Running step-by-step. We need to take care of the loops controls
    # ourselves: use the meshminimize options to stop it. KOptions will
    # keep the original values.
    if run:
        if KOptions.max_iter - step:
            mm.MAX_ITER = 1
            mm.MAX_ITER_QS = 1
            step += 1
            vertices, out = solve()
        elif KOptions.max_iter_qs - step_qs:
            mm.MAX_ITER = 0
            mm.MAX_ITER_QS = 2
            step_qs += 1
            step = 0
            vertices, out = solve()
        else:
            mm.MAX_ITER = 0
            mm.MAX_ITER_QS = 1
            vertices, out = solve()
        ran = True

elif state == 'run':
    if run:
        vertices, out = solve()
        ran = True

# Write ouptuts
if (state in ['step', 'run']) and ran:
    mesh_out = rs.AddMesh(vertices, rs.MeshFaceVertices(KMesh.mesh))
    displacements = [
        rs.VectorCreate(v1, v2)
        for (v1, v2) in zip(rs.MeshVertices(KMesh.mesh), vertices)
    ]
    stresses = out['S']
    convergence = out['convergence']
    if mm.SAVE_RESULTS:
        F_membrane = out['M']
        F_cable = out['C']
        F_pressure = out['P']
        F_gravity = out['G']
        area = out['A']

rs.EnableRedraw(prev)
# ---------- end solver ----------
panel_4 = Panel("step")
panel_5 = Panel("run")

# ----
mesh_2 = Mesh(solver.mesh_out)
disp = Vector(solver.displacements)
f_m = Vector(solver.F_membrane)
f_c = Vector(solver.F_cable)
f_p = Vector(solver.F_pressure)
f_g = Vector(solver.F_gravity)
area = Number(solver.area)
stress = Number(solver.stresses)
conv = Number(solver.convergence)

# ---- group: Raw Outputs
convergence_criterion = Panel(conv)
graph = QuickGraph(convergence_criterion)
lng = ListLength(List=convergence_criterion)
# Outputs
iterations_count = Panel(lng)
# Solver
displacements = Panel(disp)

# ---- group: Ony keep the mesh where we have an analytical solution
facen = FaceNormals(Mesh=mesh_2)  # -> Centers, Normals
pdecon = Deconstruct(Point=facen.Centers)  # -> XComponent, YComponent, ZComponent
larger = LargerThan(FirstNumber=expr("Abs(x)", pdecon.XComponent), SecondNumber=expr(".95*x/2", side_length))  # -> LargerThan, OrEqualTo
larger_2 = LargerThan(FirstNumber=expr("Abs(x)", pdecon.YComponent), SecondNumber=expr(".95*x/2", side_length))  # -> LargerThan, OrEqualTo
or = GateOr(A=larger.LargerThan, B=larger_2.LargerThan)
cullf = CullFaces(Mesh=mesh_2, Pattern=or)
facen_2 = FaceNormals(Mesh=cullf)  # -> Centers, Normals
srf_cp = SurfaceClosestPoint(Point=facen_2.Centers, Surface=srfgrid)  # -> Point, UVPoint, Distance

# ----
log_log = LogLog(data=area)

# ---- group: Display methods
index = Slider(0, range=0..100)
medges = MeshEdges(Mesh=mesh_2)  # -> NakedEdges, InteriorEdges, NonManifoldEdges
lng_2 = ListLength(List=disp)
mesh_surface_compare = MeshSurfaceCompare(surface=srfgrid, mesh=cullf)
series = Series(Start=0, Step=1, Count=lng_2)
# Display
max_error = Panel(mesh_surface_compare)
preview_displacements = PreviewDisplacements(mesh=mesh_2, displacements=disp, i=series)  # -> maximimum_normal_displacement, displacements_length, maximum_displacement_length
colorize_mesh = ColorizeMesh(mesh=cullf, streses=srf_cp.Distance)
displacement_along_normal_final_mesh = Panel(preview_displacements.maximimum_normal_displacement)
displacement_length = Panel(preview_displacements.maximum_displacement_length)
graph_2 = QuickGraph(log_log)

# ==== cluster MeshSurfaceCompare
surface = ClusterInput()  # Reference surface
mesh = ClusterInput()  # Mesh to analyze

# ---- group: Compare with mathematical solution
mesh_2 = Mesh(mesh)
demesh = DeconstructMesh(Mesh=mesh_2)  # -> Vertices, Faces, Colours, Normals
srf_cp = SurfaceClosestPoint(Point=demesh.Vertices, Surface=surface)  # -> Point, UVPoint, Distance
bnd = Bounds(Numbers=srf_cp.Distance)
dedomain = DeconstructDomain(Domain=bnd)  # -> Start, End

# ----
error = ClusterOutput(dedomain.End)  # Maximum difference between mesh and surface.

# ==== cluster ColorizeMesh
streses = ClusterInput()  # List of face stress values
mesh = ClusterInput()  # Mesh to colorize

# ---- group: Colorize output based on stresses
bnd = Bounds(Numbers=streses)
dedomain = DeconstructDomain(Domain=bnd)  # -> Start, End
expression = Expression(x=dedomain.Start, y=dedomain.End, Expression="If(abs(x-y)<1, y+1, y)")
expression_2 = Expression(x=dedomain.Start, y=expression, Expression="(y-x)/4*.99")
series = Series(Start=dedomain.Start, Step=expression_2, Count=5)
gradient = Gradient(
    LowerLimit=dedomain.Start,
    UpperLimit=expression,
    Parameter=streses,
    stops=[0.249: RGB(255, 0, 0), 0.503: RGB(255, 255, 0), 0.755: RGB(0, 255, 0)])
explode = MeshExplode(Mesh=mesh, Interpolate=False)
mcol = MeshColours(Mesh=graft(explode), Colours=graft(gradient))

# ----
split = SplitList(List=series, Index=1)  # -> ListA, ListB

# ---- group: Colorize output based on stresses (continued)
gradient_2 = Gradient(
    LowerLimit=dedomain.Start,
    UpperLimit=expression,
    Parameter=split.ListB,
    stops=[0.249: RGB(255, 0, 0), 0.503: RGB(255, 255, 0), 0.755: RGB(0, 255, 0)])
stepped_colour_legend = SteppedColourLegend(Colours=gradient_2, Start=dedomain.Start, End=expression, Title="Stresses", Description=" ")

# ----
M = ClusterOutput(mcol)

# ==== cluster PreviewDisplacements
mesh = ClusterInput()  # Mesh to analyze
displacements = ClusterInput()  # Displacements values at each node.
i = ClusterInput()  # Node number for preview

# ---- group: Displacements
demesh = DeconstructMesh(Mesh=mesh)  # -> Vertices, Faces, Colours, Normals
vec = Vector(displacements)
dprod = DotProduct(VectorA=demesh.Normals, VectorB=vec, Unitize=False)
vlen = VectorLength(Vector=vec)
bnd = Bounds(Numbers=dprod)
bnd_2 = Bounds(Numbers=vlen)
item = ListItem(List=vec, Index=i, Wrap=True)
item_2 = ListItem(List=demesh.Vertices, Index=i, Wrap=True)
vdis = VectorDisplay(Anchor=item_2, Vector=expr("-x", item))

# ----
displacements_length = ClusterOutput(vlen)  # Length of the discplacement vectors
maximum_displacement_length = ClusterOutput(bnd_2)
maximimum_normal_displacement = ClusterOutput(bnd)

# ==== cluster LogLog
data = ClusterInput()  # List of y values
lng = ListLength(List=data)
series = Series(Start=1, Step=1, Count=lng)
log = Logarithm(Value=series)
expression = Expression(x=lng, y=log, Expression="y/(Log10(x)-Log10(x-1))")
int = Integer(expression)
series_2 = Series(Start=1, Step=1, Count=0)
bnd = Bounds(Numbers=int)
repeat = RepeatData(Data=series_2, Length=expr("x+1", bnd))
log_2 = Logarithm(Value=data)
ins = InsertItems(List=repeat, Item=log_2, Indices=int, Wrap=False)
L = ClusterOutput(ins)
